# Grasshopper definition 0.0 Params.gh (Grasshopper 1.0.7)

# ---- group: I'm not a list. I'm a multiline text
panel = Panel("""a
b
c""")

# ---- group: I'm a list
panel_2 = Panel("""a
b
c""")

# ---- group: Double click me and input something
panel_3 = Panel("ABC")

# ----
# Right click -> Edit Notes... -> turn off Multiline Items
# to make a Panel output a list
panel_4 = Panel("""a
b
c""")
panel_5 = Panel("""0.0
0.1
0.2
0.3
0.4
0.5
0.6
0.7
0.8
0.9
1.0""")

# ---- group: I'm a Panel without name
# You can make a normal Panel and delete it's name
# to get a Panel without name
panel_6 = Panel("ABC")

# ----
control_knob = ControlKnob(Decimals=2, Limit=True, Maximum=10, Minimum=0, Range=1, Value=0.25)

# ---- group: Right click me -> Set Integer
integer = Integer(5)

# ---- group: Right click me -> Set Number
number = Number(3.7)

# ---- group: Right click me -> Set one Point
point = Point(Point(0, 0, 0))

# ---- group: Right click me -> Set Text
text = Text("ABC")

# ----
cherry_picker = CherryPicker(panel_4, ListIndex=0)

# ---- group: I'm a map from [0,1] to [0,1]
graph_mapper = GraphMapper(
    panel_5,
    x0=0,
    x1=1,
    y0=0,
    y1=1,
    container_name="Bezier",
    cpx=[0, 0.5402172804, 0.5094202161, 1],
    cpy=[0, 0.2141307592, 0.8547098041, 1])

# ----
data_dam = DataDam(DataA=Slider(0.25, range=0..1), BufferDelay=10000000, BufferMode=0)
panel_7 = Panel(integer)
panel_8 = Panel(number)
panel_9 = Panel(point)
panel_10 = Panel(text)
panel_11 = Panel(Slider(0.25, range=0..1))
panel_12 = Panel(Toggle(False))
panel_13 = Panel(control_knob)
panel_14 = Panel(Button())
panel_15 = Panel(panel_3)
panel_16 = Panel(panel)
panel_17 = Panel(panel_2)
panel_18 = Panel(data_dam)
panel_19 = Panel(graph_mapper)
panel_20 = Panel(cherry_picker)
