# Grasshopper definition 0.1 Evolution.gh (Grasshopper 1.0.7)

# ---- group: Step 1: right click me and Randomize 100%
# This section is less important.
# You can skip it if you want.
gene_pool = GenePool(Decimals=2, Maximum=1, Minimum=0, Value=[0.09, 0.19, 0.28, 0.37, 0.46, 0.55, 0.64, 0.73, 0.82, 0.91])

# ----
merge = Merge(Data1="0", Data2=gene_pool, Data3="1")
list_length = ListLength(List=merge)
subtraction = Subtraction(A=list_length, B="1")
range = Range(Domain=Domain(0, 1), Steps=subtraction)
construct_point = ConstructPoint(XCoordinate=range, YCoordinate=merge, ZCoordinate=0)
polyline = PolyLine(Vertices=construct_point, Closed=False)

# ---- group: Value to minimize
length = Length(Curve=polyline)

# ---- group: Step 2: double click me -> Sovers -> Start Solver, I'll try to change the parameters to minimize the length of the polyline
galapagos = Galapagos(fitness=length, gene=gene_pool)
