# Grasshopper definition 1 Math.gh (Grasshopper 1.0.7)

# ---- group: I'm also a Domain
panel = Panel("0 to 1")

# ----
panel_2 = Panel("""3
7
2
6
7
2
4""")
panel_3 = Panel("""0.0
0.1
0.2
0.3
0.4
0.5
0.6
0.7
0.8
0.9
1.0""")
panel_4 = Panel("""1
2
3
4
5
6
7
8
9
10""")
panel_5 = Panel("""1
2
3
4
5
6
7
8
9
10""")
# You can also use python scripts to calculate what you want like this:
a = Panel("72")
b = Panel("42")
construct_domain = ConstructDomain(DomainStart="3", DomainEnd="5.7")

# ---- group: Set -> Sequence -> Range
range = Range(Domain="-5 to 5", Steps=10)

# ----
bounds = Bounds(Numbers=panel_2)
number = Number(panel_4)
mass_addition = MassAddition(Input=panel_5)  # -> Result, PartialResults
pi = Pi(Factor="0.5")
addition = Addition(A="1", B="2")
subtraction = Subtraction(A="1", B="2")
multiplication = Multiplication(A="3", B="2")
division = Division(A="1", B="2")
modulus = Modulus(A="5", B="3")
larger_than = LargerThan(FirstNumber="3", SecondNumber="1")  # -> LargerThan, OrEqualTo
square_root = SquareRoot(Value="2")
power_of_e = PowerOfE(Value="5")
cube = Cube(Value="3")

# ---- group: Double click to edit the script
ghpython_script = GhPythonScript(x=a, y=b)  # -> out, a; inputs x: Int32, y: Int32
# ---------- ghpython_script: Python ----------
__author__ = "Shengzhi Wu"
__version__ = "2022.07.26"

import rhinoscriptsyntax as rs

a = x

while x!=0:
    if x==0:
        break
    if x>y:
        z = x
        x = y
        y = z
    else:
        z = y%x
        y = x
        x = z
    print x, y

a = y
# ---------- end ghpython_script ----------

# ----
cosine = Cosine(Value="1")
panel_6 = Panel(range)
remap_numbers = RemapNumbers(Value=panel_3, Source="0 to 1", Target="3 to 5")  # -> Mapped, Clipped
average = Average(Input=number)
round = Round(Number=Slider(3.4, range=0..10))  # -> Nearest, Floor, Ceiling

# ---- group: Double click to edit the expression
expression = Expression(x=range, Expression="1/(1+exp(-x))")

# ----
panel_7 = Panel(bounds)
deconstruct_domain = DeconstructDomain(Domain=construct_domain)  # -> Start, End

# ---- group: GCD(a, b)
panel_8 = Panel(ghpython_script.a)

# ----
panel_9 = Panel(construct_domain)
panel_10 = Panel(addition)
panel_11 = Panel(subtraction)
panel_12 = Panel(multiplication)
panel_13 = Panel(division)
panel_14 = Panel(modulus)
panel_15 = Panel(pi)
deconstruct_domain_2 = DeconstructDomain(Domain=bounds)  # -> Start, End
panel_16 = Panel(mass_addition.Result)
panel_17 = Panel(mass_addition.PartialResults)
panel_18 = Panel(square_root)
panel_19 = Panel(power_of_e)
panel_20 = Panel(cube)

# ---- group: cos 1
panel_21 = Panel(cosine)

# ----
panel_22 = Panel(ghpython_script.out)
gate_and = GateAnd(A=larger_than.LargerThan, B="False")
panel_23 = Panel(round.Floor)
panel_24 = Panel(round.Ceiling)
panel_25 = Panel(round.Nearest)
panel_26 = Panel(remap_numbers.Mapped)
panel_27 = Panel(larger_than.LargerThan)

# ---- group: Mean value
panel_28 = Panel(average)

# ----
panel_29 = Panel(expression)
panel_30 = Panel(gate_and)
panel_31 = Panel(deconstruct_domain.End)
panel_32 = Panel(deconstruct_domain.Start)

# ---- group: The maximum
panel_33 = Panel(deconstruct_domain_2.Start)

# ---- group: The minimum
panel_34 = Panel(deconstruct_domain_2.End)

# ---- group: Display -> Graphs -> Quich Graph
quick_graph = QuickGraph(expression, SortOrder=0)
