# Grasshopper definition 10.0 Kangroo.gh (Grasshopper 1.0.7)
# plug-ins: Kangaroo2 Components

polygon = Polygon(Plane=PlaneXY(0, 0, 0), Radius="20", Segments="20", FilletRadius=0)  # -> Polygon, Length
explode = Explode(Curve=polygon.Polygon, Recursive=True)  # -> Segments, Vertices
shift_list = ShiftList(List=explode.Segments, Shift=1, Wrap=True)
grab = Grab(On=True, Strength=1, Range=3)
length_line = LengthLine(Line=explode.Segments, Strength="1")
angle = Angle(LineA=explode.Segments, LineB=shift_list, RestAngle="0", Strength=1)
anchorxyz = AnchorXYZ(Point=explode.Vertices, X=False, Y=False, Z=Toggle(True), Strength="1")
mesh_plane = MeshPlane(Boundary={Plane=PlaneXY(0, 0, 0), Size=Domain2(u=-10..10, v=-10..10)}, WidthCount="10", HeightCount="10")  # -> Mesh, Area
mesh_edges = MeshEdges(Mesh=mesh_plane.Mesh)  # -> NakedEdges, InteriorEdges, NonManifoldEdges
entwine = Entwine(Branch00=grab, Branch01=length_line, Branch02=anchorxyz, Branch03=angle, FlattenInputs=True)
panel = Panel("""{10,10,0}
{10,-10,0}
{-10,10,0}
{-10,-10,0}""")
bouncysolver = BouncySolver(GoalObjects=entwine, Reset=Button(), Threshold=1e-15, Tolerance=0.01, Damping=0.99, Iterations=10, On=Toggle(False))  # -> I, V, O
merge = Merge(Data1=mesh_edges.NakedEdges, Data2=mesh_edges.InteriorEdges)
length = Length(Curve=merge)
point = Point(panel)
panel_2 = Panel(entwine)
multiplication = Multiplication(A=length, B=Slider(0.531, range=0..1))
anchor = Anchor(Point=point, Strength="1")
grab_2 = Grab(On=True, Strength=1, Range=3)
length_line_2 = LengthLine(Line=merge, Length=multiplication, Strength="1")
entwine_2 = Entwine(Branch00=grab_2, Branch01=length_line_2, Branch02=anchor, FlattenInputs=True)
bouncysolver_2 = BouncySolver(GoalObjects=entwine_2, Reset=Button(), Threshold=1e-15, Tolerance=0.01, Damping=0.99, Iterations=10, On=Toggle(True))  # -> I, V, O
