# Grasshopper definition 10.1 Rigid bodies in Kangroo.gh (Grasshopper 1.0.7)
# plug-ins: MeshEdit Components, Kangaroo2 Components

# There are two rigid boxes connected by an invisible beam.
# The red box is fixed.
# You can drag the blue one to move and rotate it.
center_domain = CenterDomain(half_width="1")
domain_box = DomainBox(Base=PlaneXY(0, 0, 0), X=center_domain, Y=center_domain, Z=center_domain)
yz_plane = YZPlane(Origin=Point(0, 0, 0))
mesh_box = MeshBox(Base=domain_box, XCount="1", YCount="1", ZCount="1")
mesh_weldvertices = MeshWeldVertices(Mesh=mesh_box, Tolerance=0.01)  # -> RuntimeMessage, Mesh
move = Move(Geometry=yz_plane, Motion="{5,0,0}")  # -> Geometry, Transform
mesh_unifynormals = MeshUnifyNormals(Mesh=mesh_weldvertices.Mesh)
mesh_colours = MeshColours(Mesh=mesh_unifynormals, Colours=ColourSwatch(SwatchColor=RGB(235, 66, 66)))
orient = Orient(Geometry=mesh_colours, Source=yz_plane, Target=move.Geometry)  # -> Geometry, Transform
mesh_colours_2 = MeshColours(Mesh=orient.Geometry, Colours=ColourSwatch(SwatchColor=RGB(66, 108, 235)))

# ---- group: The smaller this value is, the easier it is to rotate the blue box around X axes
panel = Panel("0.1")

# ----
deconstruct_mesh = DeconstructMesh(Mesh=mesh_colours)  # -> Vertices, Faces, Colours, Normals
deconstruct_mesh_2 = DeconstructMesh(Mesh=mesh_colours_2)  # -> Vertices, Faces, Colours, Normals
rigidbody = RigidBody(Part=mesh_colours, Plane=yz_plane, Points=deconstruct_mesh.Vertices, Strength=10)  # -> RigidBody, Planes
rigidbody_2 = RigidBody(Part=mesh_colours_2, Plane=move.Geometry, Points=deconstruct_mesh_2.Vertices, Strength=10)  # -> RigidBody, Planes
support = Support(Frame=yz_plane, X=True, Y=True, Z=True, XX=True, YY=True, ZZ=True, Strength=100)

# ---- group: The virtual beam
beam = Beam(
    StartFrame=yz_plane,
    EndFrame=move.Geometry,
    StartNode=yz_plane,
    EndNode=move.Geometry,
    E=1,
    A=panel,
    Ix=1,
    Iy=1,
    GJ=panel)

# ----
solidcollide = SolidCollide(MeshA=mesh_colours, MeshB=mesh_colours_2, PlaneA=yz_plane, PlaneB=move.Geometry, Strength=1)
grab = Grab(On=True, Strength=1, Range=3)
entwine = Entwine(
    Branch00=grab,
    Branch01=support,
    Branch02=rigidbody.RigidBody,
    Branch03=rigidbody_2.RigidBody,
    Branch04=solidcollide,
    Branch05=beam,
    FlattenInputs=True)
bouncysolver = BouncySolver(GoalObjects=entwine, Reset=Button(), Threshold=1e-15, Tolerance=0.01, Damping=0.99, Iterations=10, On=Toggle(True))  # -> I, V, O

# ==== cluster CenterDomain
half_width = ClusterInput()
center = ClusterInput()
number = Number(half_width)
number_2 = Number(center)
negative = Negative(Value=number)
addition = Addition(A=number_2, B=negative)
addition_2 = Addition(A=number_2, B=number)
construct_domain = ConstructDomain(DomainStart=addition, DomainEnd=addition_2)
domain = ClusterOutput(construct_domain)
