# Grasshopper definition 11 Make calculations more efficient.gh (Grasshopper 1.0.7)
# plug-ins: DendroGH

# Another method to save time is to use Data Dams (Params -> Util -> Data Dam),
# which can temporarily block data transmission until you click the button on it.
panel = Panel("-1 to 1")
# Display -> Canvas Widgets -> Profiler
# to show the time spent by each calculationally expensive component.
panel_2 = Panel("10000")
# or (using Dendro):
domain_box = DomainBox(Base=PlaneXY(0, 0, 0), X="-1 to 1", Y="-1 to 1", Z="-1 to 1")
domain_box_2 = DomainBox(Base=PlaneXY(0, 0, 0), X="-1 to 1", Y="-1 to 1", Z="-1 to 1")
domain_box_3 = DomainBox(Base=PlaneXY(0, 0, 0), X="-1 to 1", Y="-1 to 1", Z="-1 to 1")
# The 1st multiplication component is about 10 times as calculationally expensive as the 2nd one.
# Why?
# The 1st one has to convert the input string "2" to a real number 2 10000 times!
# So if you are going to use a data thousands of times, make sure it is in the appropriate type.
panel_3 = Panel("2")
range = Range(Domain=Domain(0, 1), Steps=panel_2)
# Boolean calculations are expensive.
# Ues them as less as possible.
# Or you can consider to use some substitutions like:
panel_4 = Panel("15")
domain_box_4 = DomainBox(Base=PlaneXY(0, 0, 0), X=panel, Y=panel, Z=panel)
populate_3d = Populate3D(Region=domain_box, Count="15", Seed=1)
number = Number("2")
populate_3d_2 = Populate3D(Region=domain_box_2, Count="15", Seed=1)
populate_3d_3 = Populate3D(Region=domain_box_3, Count=panel_4, Seed=1)
populate_3d_4 = Populate3D(Region=domain_box_4, Count="15", Seed=1)

# ---- group: 1. Change the value
number_slider = Slider(0.721, range=0.5..1)

# ---- group: 1st
multiplication = Multiplication(A=range, B="2")

# ---- group: 2nd
multiplication_2 = Multiplication(A=range, B=number)

# ----
mesh_sphere = MeshSphere(Base=populate_3d, Radius=Slider(0.721, range=0.5..1), UCount=10, VCount=20)
sphere = Sphere(Base=populate_3d_3, Radius=Slider(0.721, range=0.5..1))
mesh_sphere_2 = MeshSphere(Base=populate_3d_2, Radius=Slider(0.721, range=0.5..1), UCount=10, VCount=20)
sphere_2 = Sphere(Base=populate_3d_4, Radius=number_slider)
create_settings = CreateSettings(VoxelSize="0.03", Bandwidth=1, Isovalue=0, Adaptivity=0.1)

# ---- group: 2. Click the button
data_dam = DataDam(DataA=sphere_2, BufferDelay=10000000, BufferMode=0)

# ----
mesh_join = MeshJoin(Meshes=mesh_sphere)
solid_union = SolidUnion(Breps=sphere)
solid_union_2 = SolidUnion(Breps=data_dam)

# ---- group: Meshs boolean calculations are faster than ones of breps
mesh_union = MeshUnion(Meshes=mesh_sphere_2)

# ---- group: Dendor can be used for very complicated boolean calculations. But the details may get lost.
mesh_to_volume = MeshToVolume(Mesh=mesh_join, Settings=create_settings)
volume_to_mesh = VolumeToMesh(Volume=mesh_to_volume, VolumeSettings=create_settings)
