# Grasshopper definition 12 Weavebird.gh (Grasshopper 1.0.7)
# plug-ins: Weaverbird, MeshEdit Components

weaverbird_s_mesh_mesh_icosahedron = WeaverbirdsMeshMeshIcosahedron(Plane="{2.5,0,0}", Radius="1")
# Download the plugin Weavebird at
# https://www.giuliopiacentino.com/weaverbird/
weaverbird_s_polylines_dodecahedron = WeaverbirdsPolylinesDodecahedron(Plane=PlaneXY(0, 0, 0), Radius="1")
weaverbird_s_tile = WeaverbirdsTile(MeshCurves=weaverbird_s_polylines_dodecahedron, FillStrategy=1, OptIn=2)
weaverbird_s_picture_frame = WeaverbirdsPictureFrame(MeshPolylines=weaverbird_s_mesh_mesh_icosahedron, Distance="0.2", InsetType=0)
mesh_weldvertices = MeshWeldVertices(Mesh=weaverbird_s_tile, Tolerance=0.01)  # -> RuntimeMessage, Mesh
weaverbird_s_mesh_thicken = WeaverbirdsMeshThicken(MeshCurves=weaverbird_s_picture_frame, Distance="0.2", OffsetType=0)
deconstruct_mesh = DeconstructMesh(Mesh=mesh_weldvertices.Mesh)  # -> Vertices, Faces, Colours, Normals
weaverbird_s_catmull_clark_subdivision = WeaverbirdsCatmullClarkSubdivision(MeshCurves=weaverbird_s_mesh_thicken, Level="3", SmoothNakedEdges=1)
construct_mesh = ConstructMesh(Vertices=deconstruct_mesh.Vertices, Faces=deconstruct_mesh.Faces)
