# Grasshopper definition 12.1 Weavebird.gh (Grasshopper 1.0.7)
# plug-ins: Weaverbird

boolean_toggle = BooleanToggle(True)
point = Point([Point(-1.905410234, -0.7815129001, -0.2790112165), Point(-0.8827924886, 2.052599137, 0), Point(1.435141067, 2.033120703, 0.09388264919), Point(2.466419395, 1.059199041, -0.4798575582), Point(-0.1815688919, 0.4164107443, 1.154822957), Point(-0.1718296753, -1.658042396, 0)])
polyline = PolyLine(Vertices=point, Closed=boolean_toggle)
nurbs_curve = NurbsCurve(Vertices=point, Degree=3, Periodic=boolean_toggle)  # -> Curve, Length, Domain
weaverbird_s_tile = WeaverbirdsTile(MeshCurves=polyline, FillStrategy=1, OptIn=2)

# ---- group: The NURBS curve
custom_preview = CustomPreview(Geometry=nurbs_curve.Curve, Material=ColourSwatch(SwatchColor=RGB(255, 255, 0)))

# ---- group: The limit boundaries of the subdivided meshs are the NURBS curve
weaverbird_s_catmull_clark_subdivision = WeaverbirdsCatmullClarkSubdivision(MeshCurves=weaverbird_s_tile, Level="3", SmoothNakedEdges=1)
weaverbird_s_loop_subdivision = WeaverbirdsLoopSubdivision(MeshCurves=weaverbird_s_tile, Level="3", SmoothNakedEdges=1)
