# Grasshopper definition 13 Anemone.gh (Grasshopper 1.0.7)
# plug-ins: Anemone

unit_z = UnitZ(Factor=1)
# Download the plugin Anemone at
# https://www.food4rhino.com/en/app/anemone
restart = Button()
restart_2 = Button()
entwine = Entwine(Branch00="{0,0,0}", Branch01=unit_z, FlattenInputs=True)
loop_start = LoopStart(Repeat="5", Trigger=restart_2, Data=entwine)  # -> port, Counter, Data

# ---- group: int j=0;
panel = Panel("0")

# ----
explode_tree = ExplodeTree(Data=loop_start.Data)  # -> Branch0, Branch1, Branch2
sphere = Sphere(Base=PlaneXY(0, 0, 0), Radius="0.6")
list_length = ListLength(List=explode_tree.Branch0)
power = Power(A="0.7", B=loop_start.Counter)
line_sdl = LineSDL(Start=explode_tree.Branch0, Direction=explode_tree.Branch1, Length=power)
multiplication = Multiplication(A=list_length, B="3")
power_2 = Power(A="0.5", B=loop_start.Counter)
populate_geometry = PopulateGeometry(Geometry=sphere, Count=multiplication, Seed=loop_start.Counter)
end_points = EndPoints(Curve=line_sdl)  # -> Start, End
multiplication_2 = Multiplication(A="0.1", B=power_2)
multiplication_3 = Multiplication(A=multiplication_2, B="0.5")
stack_data = StackData(Data=end_points.End, Stack="3")
partition_list = PartitionList(List=populate_geometry, Size="3")
addition = Addition(A=graft(explode_tree.Branch1), B=partition_list)  # -> flatten(Result)
merge = Merge(Data1=multiplication_2, Data2=multiplication_3)
panel_2 = Panel("""0
1""")
unit_vector = UnitVector(Vector=addition)
pipe_variable = PipeVariable(Curve=line_sdl, Parameters=panel_2, Radii=merge, Caps=0)
mesh_surface = MeshSurface(Surface=pipe_variable, UCount="1", VCount="5", Overhang=True, Equalize=False)  # -> flatten(Mesh)
entwine_2 = Entwine(Branch00=stack_data, Branch01=unit_vector, Branch02=mesh_surface, FlattenInputs=True)
loop_end = LoopEnd(port=loop_start.port, Exit=False, Data=entwine_2, TimeOutVal=0, pausedState=False, state="Constant & Record")
path_mapper = PathMapper(loop_end, source="{A;B;C}", target="{C;A}")
trim_tree = TrimTree(Tree=path_mapper, Depth=1)
explode_tree_2 = ExplodeTree(Data=trim_tree)  # -> Branch0, Branch1, Branch2
mesh_join = MeshJoin(Meshes=explode_tree_2.Branch2)
data_dam = DataDam(DataA=mesh_join, BufferDelay=10000000, BufferMode=0)
xy_plane = XYPlane(Origin=Point(0, 0, 0))
mesh_shadow = MeshShadow(Mesh=data_dam, Light="{1,0,-2}", Plane=xy_plane)
boundary_surfaces = BoundarySurfaces(Edges=mesh_shadow)
custom_preview = CustomPreview(Geometry=boundary_surfaces, Material=ColourSwatch(SwatchColor=RGBA(0, 0, 0, 43)))

# ---- group: for(int i=0;i<=100;i++)
loop_start_2 = LoopStart(Repeat="100", Trigger=restart, Data=panel)  # -> port, Counter, Data

# ---- group: j++;
addition_2 = Addition(A=loop_start_2.Data, B="1")

# ---- group: for(int i=0;i<=100;i++) (continued)
loop_end_2 = LoopEnd(port=loop_start_2.port, Exit=False, Data=addition_2, TimeOutVal=0, pausedState=False, state="Constant output")

# ----
panel_3 = Panel(loop_end_2)
