# Grasshopper definition 13 Dendro.gh (Grasshopper 1.0.7)
# plug-ins: DendroGH

# Download the plugin Dendro at
# https://www.food4rhino.com/en/app/dendro
panel = Panel("1")
domain_box = DomainBox(Base=PlaneXY(0, 0, 0), X="0 to 2", Y="0 to 2", Z="0 to 2")
mesh_sphere = MeshSphere(Base=PlaneXY(0, 0, 0), Radius=panel, UCount=10, VCount=20)
mesh_box = MeshBox(Base=domain_box, XCount=10, YCount=10, ZCount=10)
create_settings = CreateSettings(VoxelSize="0.07", Bandwidth=1, Isovalue=0, Adaptivity=0.1)
merge = Merge(Data1=mesh_sphere, Data2=mesh_box)
mesh_join = MeshJoin(Meshes=merge)
mesh_to_volume = MeshToVolume(Mesh=mesh_join, Settings=create_settings)
smooth_volume = SmoothVolume(Volume=mesh_to_volume, Width=1, Type=2, Iterations="5")
volume_to_mesh = VolumeToMesh(Volume=smooth_volume, VolumeSettings=create_settings)
