# Grasshopper definition 14 Anemone.gh (Grasshopper 1.0.7)
# plug-ins: Anemone

unit_z = UnitZ(Factor=1)
# This example calculate the greatest common divisor (GCD) of 2 integers.
a = Panel("72")
b = Panel("42")
# Download the plugin Anemone at
# https://www.food4rhino.com/en/app/anemone
restart = Button()
merge = Merge(Data1=a, Data2=b)
# This example makes a tree.
restart_2 = Button()
restart_3 = Button()
entwine = Entwine(Branch00="{0,0,0}", Branch01=unit_z, FlattenInputs=True)
loop_start = LoopStart(Repeat="5", Trigger=restart_2, Data=entwine)  # -> port, Counter, Data
loop_start_2 = LoopStart(Repeat="100", Trigger=restart_3, Data=merge)  # -> port, Counter, Data

# ---- group: int j=0;
panel = Panel("0")

# ----
list_item = ListItem(List=loop_start_2.Data, Index=0, Wrap=True)  # -> Item, Item1
integer = Integer("1")
explode_tree = ExplodeTree(Data=loop_start.Data)  # -> Branch0, Branch1, Branch2
maximum = Maximum(A=list_item.Item, B=integer)
sphere = Sphere(Base=PlaneXY(0, 0, 0), Radius="0.6")
larger_than = LargerThan(FirstNumber=list_item.Item, SecondNumber=list_item.Item1)  # -> LargerThan, OrEqualTo
list_length = ListLength(List=explode_tree.Branch0)
integer_2 = Integer("0")
power = Power(A="0.7", B=loop_start.Counter)
merge_2 = Merge(Data1=list_item.Item1, Data2=list_item.Item)
modulus = Modulus(A=list_item.Item1, B=maximum)
line_sdl = LineSDL(Start=explode_tree.Branch0, Direction=explode_tree.Branch1, Length=power)
equality = Equality(FirstNumber=integer_2, SecondNumber=list_item.Item)  # -> Equality, Inequality
multiplication = Multiplication(A=list_length, B="3")
power_2 = Power(A="0.5", B=loop_start.Counter)
populate_geometry = PopulateGeometry(Geometry=sphere, Count=multiplication, Seed=loop_start.Counter)
end_points = EndPoints(Curve=line_sdl)  # -> Start, End
merge_3 = Merge(Data1=modulus, Data2=list_item.Item)
multiplication_2 = Multiplication(A="0.1", B=power_2)
stream_filter = StreamFilter(Gate=larger_than.LargerThan, Stream0=merge_3, Stream1=merge_2)
multiplication_3 = Multiplication(A=multiplication_2, B="0.5")
stack_data = StackData(Data=end_points.End, Stack="3")
stream_filter_2 = StreamFilter(Gate=equality.Equality, Stream0=stream_filter, Stream1=loop_start_2.Data)
loop_end = LoopEnd(
    port=loop_start_2.port,
    Exit=equality.Equality,
    Data=stream_filter_2,
    TimeOutVal=0,
    pausedState=False,
    state="Constant output")
partition_list = PartitionList(List=populate_geometry, Size="3")
addition = Addition(A=graft(explode_tree.Branch1), B=partition_list)  # -> flatten(Result)
merge_4 = Merge(Data1=multiplication_2, Data2=multiplication_3)
panel_2 = Panel("""0
1""")
list_item_2 = ListItem(List=loop_end, Index=0, Wrap=True)  # -> Item, Item1
panel_3 = Panel(loop_end)
unit_vector = UnitVector(Vector=addition)
pipe_variable = PipeVariable(Curve=line_sdl, Parameters=panel_2, Radii=merge_4, Caps=0)
gcd_a_b = Panel(list_item_2.Item1)
mesh_surface = MeshSurface(Surface=pipe_variable, UCount="1", VCount="5", Overhang=True, Equalize=False)  # -> flatten(Mesh)
entwine_2 = Entwine(Branch00=stack_data, Branch01=unit_vector, Branch02=mesh_surface, FlattenInputs=True)
loop_end_2 = LoopEnd(port=loop_start.port, Exit=False, Data=entwine_2, TimeOutVal=0, pausedState=False, state="Constant & Record")
path_mapper = PathMapper(loop_end_2, source="{A;B;C}", target="{C;A}")
trim_tree = TrimTree(Tree=path_mapper, Depth=1)
explode_tree_2 = ExplodeTree(Data=trim_tree)  # -> Branch0, Branch1, Branch2
mesh_join = MeshJoin(Meshes=explode_tree_2.Branch2)
data_dam = DataDam(DataDataA=mesh_join, BufferDelay=10000000, BufferMode=0)
xy_plane = XYPlane(Origin=Point(0, 0, 0))
mesh_shadow = MeshShadow(Mesh=data_dam, Light="{1,0,-2}", Plane=xy_plane)
boundary_surfaces = BoundarySurfaces(Edges=mesh_shadow)
custom_preview = CustomPreview(Geometry=boundary_surfaces, Material=ColourSwatch(SwatchColor=RGBA(0, 0, 0, 43)))

# ---- group: for(int i=0;i<=100;i++)
loop_start_3 = LoopStart(Repeat="100", Trigger=restart, Data=panel)  # -> port, Counter, Data

# ---- group: j++;
addition_2 = Addition(A=loop_start_3.Data, B="1")

# ---- group: for(int i=0;i<=100;i++) (continued)
loop_end_3 = LoopEnd(port=loop_start_3.port, Exit=False, Data=addition_2, TimeOutVal=0, pausedState=False, state="Constant output")

# ----
panel_4 = Panel(loop_end_3)
