# Grasshopper definition 2.1 Set.gh (Grasshopper 1.0.7)

panel = Panel("""10
20
30""")
panel_2 = Panel("""1
2
3
4
5""")
addition = Addition(A=panel_2, B=panel)
graft_tree = GraftTree(Tree=panel_2, IncludeEmptyLists=True, IncludeNullItems=True)
simplify_tree = SimplifyTree(Tree=graft_tree, Front=False)
addition_2 = Addition(A=graft_tree, B=panel)

# ---- group: Their outputs are the same / You can use internal Flatten like this
addition_3 = Addition(A=graft_tree, B=panel)  # -> flatten(Result)

# ----
panel_3 = Panel("""100
200
300""")
flip_matrix = FlipMatrix(Data=addition_2)
graft_tree_2 = GraftTree(Tree=flip_matrix, IncludeEmptyLists=True, IncludeNullItems=True)

# ---- group: Params -> Util -> Param Viewer
param_viewer = ParamViewer(panel_2)
param_viewer_2 = ParamViewer(graft_tree)
param_viewer_3 = ParamViewer(simplify_tree)
param_viewer_4 = ParamViewer(graft_tree_2)
param_viewer_5 = ParamViewer(flip_matrix)
param_viewer_6 = ParamViewer(graft_tree_2)

# ----
panel_4 = Panel("""a
b
c
d
e""")
panel_5 = Panel("""1
2
3
4
5""")
path_mapper = PathMapper(panel_5, source="{B}(A)", target="{0;B}(A)")

# ---- group: Their outputs are the same
flatten_tree = FlattenTree(Tree=addition_2, Path="{0}")

# ----
panel_6 = Panel(addition_2)
panel_7 = Panel(addition)
panel_8 = Panel(simplify_tree)
panel_9 = Panel(path_mapper)
panel_10 = Panel(graft_tree_2)
panel_11 = Panel(flip_matrix)
panel_12 = Panel(flatten_tree)
addition_4 = Addition(A=graft_tree_2, B=panel_3)

# ---- group: Set -> Tree -> Path Mapper
path_mapper_2 = PathMapper(addition_4, source="{A;B;C}(D)", target="{D;B}(C)")

# ----
panel_13 = Panel(graft_tree)
tree_statistics = TreeStatistics(Tree=addition_2)  # -> Paths, Length, Count
merge = Merge(Data1=panel_5, Data2=panel_4)
trim_tree = TrimTree(Tree=path_mapper_2, Depth="1")
explode_tree = ExplodeTree(Data=trim_tree)  # -> Branch0, Branch1, Branch2
entwine = Entwine(Branch00=panel_5, Branch01=panel_4, FlattenInputs=True)
merge_2 = Merge(Data1=flatten(panel_9), Data2=flatten(panel_4))
merge_3 = Merge(Data1=panel_9, Data2=panel_4)
panel_14 = Panel(addition_4)
panel_15 = Panel(tree_statistics.Paths)
panel_16 = Panel(tree_statistics.Length)
panel_17 = Panel(tree_statistics.Count)

# ---- group: Data in different path will not merge
panel_18 = Panel(merge_3)

# ---- group: You can merge after flattening them
panel_19 = Panel(merge_2)

# ----
stream_filter = StreamFilter(Gate=Slider(1, range=0..2), Stream0="a", Stream1="b", Stream2="c")
panel_20 = Panel(path_mapper_2)
panel_21 = Panel(trim_tree)
panel_22 = Panel(merge)
panel_23 = Panel(explode_tree.Branch0)
panel_24 = Panel(stream_filter)
panel_25 = Panel(entwine)
