# Grasshopper definition 2.2 Set.gh (Grasshopper 1.0.7)

one_over_x = OneOverX(Value="5")
# Let's make a 3d array of points.
# There are several ways to do it.
one_over_x_2 = OneOverX(Value="5")
range = Range(Domain=Domain(0, 1), Steps="5")
range_2 = Range(Domain=Domain(0, 1), Steps="5")
range_3 = Range(Domain=Domain(0, 1), Steps="5")
point = Point("{0,0,0}")
addition = Addition(A="5", B="1")
range_4 = Range(Domain=Domain(0, 1), Steps="5")
domain_box = DomainBox(Base=PlaneXY(0, 0, 0), X=one_over_x, Y=one_over_x, Z=one_over_x)

# ---- group: Vector -> Grid -> Square
square = Square(Plane=PlaneXY(0, 0, 0), Size=one_over_x_2, ExtentX="5", ExtentY="5")  # -> Cells, Points

# ----
unit_z = UnitZ(Factor=range)

# ---- group: Vector -> Vector -> ...
unit_x = UnitX(Factor=range_2)
unit_y = UnitY(Factor=range_2)  # -> graft(UnitVector)
unit_z_2 = UnitZ(Factor=range_2)  # -> graft(UnitVector)

# ----
cross_reference = CrossReference(ListA=range_3, ListB=range_3, ListC=range_3, CrossMode=1)  # -> ListA, ListB, ListC

# ---- group: This will not work
construct_point = ConstructPoint(XCoordinate=range_4, YCoordinate=range_4, ZCoordinate=range_4)

# ----
addition_2 = Addition(A=graft(square.Points), B=unit_z)
construct_point_2 = ConstructPoint(XCoordinate=cross_reference.ListA, YCoordinate=cross_reference.ListB, ZCoordinate=cross_reference.ListC)

# ---- group: Transform -> Array -> Box Array
box_array = BoxArray(Geometry=point, Cell=domain_box, XCount=addition, YCount=addition, ZCount=addition)  # -> Geometry, Transform

# ----
addition_3 = Addition(A=unit_x, B=unit_y)  # -> flatten(Result)
addition_4 = Addition(A=addition_3, B=unit_z_2)  # -> flatten(Result)
point_2 = Point(addition_4)
