# Grasshopper definition 2.3 Set.gh (Grasshopper 1.0.7)

# Let's make an array, each item of which consists of a point and a circle.
# There are more than 1 way to do it.
panel = Panel("{0,0,0}")
# In more complicated cases, using groups can be more convenient.
series = Series(Start=0, Step=1, Count=10)
circle = Circle(Plane=PlaneXY(0, 0, 0), Radius=1)
point = Point(panel)
unit_z = UnitZ(Factor=series)

# ---- group: This is the item we are going to use to make an array
merge = Merge(Data1=point, Data2=circle)

# ---- group: In fact the behavior of the move component above is like this
longest_list = LongestList(ListListA=merge, ListListB=unit_z, PaddingMode=2)  # -> ListListA, ListListB
move = Move(Geometry=longest_list.ListListA, Motion=longest_list.ListListB)  # -> Geometry, Transform

# ---- group: This doesn't work
move_2 = Move(Geometry=merge, Motion=unit_z)  # -> Geometry, Transform

# ---- group: This does work
move_3 = Move(Geometry=merge, Motion=graft(unit_z))  # -> Geometry, Transform

# ---- group: Transform -> Util -> ...
# Note that goups only work for geometries.
# You can NOT use them for numbers.
group = Group(Objects=merge)

# ----
move_4 = Move(Geometry=group, Motion=unit_z)  # -> Geometry, Transform

# ---- group: Transform -> Util -> ... (continued)
ungroup = Ungroup(Group=move_4.Geometry)
