# Grasshopper definition 2_0 Set List.gh (Grasshopper 1.0.7)

panel = Panel("""a
b
c
d
e
f
g
h
i
j
k
l""")

# ---- group: Where to put every items
panel_2 = Panel("""0
1""")

# ----
panel_3 = Panel("""a
b
c
d
e""")

# ---- group: List to be sorted
panel_4 = Panel("""1
3
5
4
2""")

# ---- group: List to be arranged at the same time
panel_5 = Panel("""a1
b3
c5
d4
e2""")

# ----
panel_6 = Panel("""a
b
c
d
e""")

# ---- group: Where to put every items
panel_7 = Panel("""True
False""")

# ----
panel_8 = Panel("""a
b
c
d
e
f
g
h
i
j
k
l""")
panel_9 = Panel("""a
b
c
d
e""")

# ---- group: Strength
number_slider = Slider(0.03, range=0..1)

# ---- group: There can be more than 2 outputs
sift_pattern = SiftPattern(List=panel, SiftPattern=panel_2)  # -> Output0, Output1

# ----
panel_10 = Panel("""a
b
c
d
e""")
panel_11 = Panel("""a
b
c""")
range = Range(Domain=Domain(0, 1), Steps="100")
panel_12 = Panel("""a
b
c""")
panel_13 = Panel("""a
b
c
d
e""")
series = Series(Start=0, Step="0.1", Count="100")

# ---- group: Don't use it. There may be some bug
item_index = ItemIndex(List=panel_3, Item="b")

# ----
panel_14 = Panel("""1
2
3""")
panel_15 = Panel("""a
b
c
d
e""")
list_length = ListLength(List=panel_9)
list_item = ListItem(List=panel_6, Index=Slider(1, range=0..4), Wrap=True)
dispatch = Dispatch(List=panel_8, DispatchPattern=panel_7)  # -> ListA, ListB
panel_16 = Panel("""1
3""")
panel_17 = Panel("""a
b
c
d
e""")
longest_list = LongestList(ListListA=panel_17, ListListB="True", PaddingMode=2)  # -> ListListA, ListListB
repeat_data = RepeatData(Data=panel_12, Length="6")
panel_18 = Panel("""1
2
3
5
3
1""")
stack_data = StackData(Data=panel_11, Stack="2")
panel_19 = Panel("""0
1""")
split_list = SplitList(List=panel_10, Index=Slider(2, range=0..5))  # -> ListA, ListB
sort_list = SortList(Keys=panel_4, ValuesA=panel_5)  # -> Keys, ValuesA
shift_list = ShiftList(List=panel_13, Shift=Slider(2, range=0..5), Wrap=True)
random = Random(Range=Domain(0, 1), Number="100", Seed=2)
replace_items = ReplaceItems(List=longest_list.ListListB, Item="False", Indices=panel_16, Wrap=False)
panel_20 = Panel(longest_list.ListListB)

# ---- group: Delete Nulls
null_item = NullItem(Item=sift_pattern.Output0)  # -> NullFlags, InvalidFlags, Description
null_item_2 = NullItem(Item=sift_pattern.Output1)  # -> NullFlags, InvalidFlags, Description
cull_pattern = CullPattern(List=sift_pattern.Output0, CullPattern=invert(null_item.NullFlags))
cull_pattern_2 = CullPattern(List=sift_pattern.Output1, CullPattern=invert(null_item_2.NullFlags))

# ----
shortest_list = ShortestList(ListA=panel_15, ListB=panel_14, TrimMode=2)  # -> ListA, ListB
panel_21 = Panel(series)
panel_22 = Panel(range)

# ---- group: Randomly rearrange the items
jitter = Jitter(List=range, Jitter=number_slider, Seed=2)  # -> Values, Indices

# ----
cull_index = CullIndex(List=panel_17, Indices=panel_16, Wrap=True)

# ---- group: Remove duplicated items
create_set = CreateSet(List=panel_18)  # -> Set, Map

# ---- group: Length of the list
panel_23 = Panel(list_length)

# ----
pick_n_choose = PickNChoose(Pattern=panel_19, Stream0=dispatch.ListA, Stream1=dispatch.ListB)
weave = Weave(Pattern=panel_19, Stream0=dispatch.ListA, Stream1=dispatch.ListB, NullGaps=False)
panel_24 = Panel(repeat_data)
panel_25 = Panel(stack_data)
cull_pattern_3 = CullPattern(List=panel_17, CullPattern=replace_items)
panel_26 = Panel(list_item)
panel_27 = Panel(dispatch.ListA)
panel_28 = Panel(dispatch.ListB)
panel_29 = Panel(split_list.ListA)
panel_30 = Panel(split_list.ListB)
panel_31 = Panel(shift_list)
panel_32 = Panel(sort_list.Keys)
panel_33 = Panel(sort_list.ValuesA)

# ---- group: In my version (1.0.0007), the output is -1, which is wrong
panel_34 = Panel(item_index)

# ----
panel_35 = Panel(replace_items)
panel_36 = Panel(create_set.Set)
panel_37 = Panel(random)
panel_38 = Panel(shortest_list.ListB)
panel_39 = Panel(shortest_list.ListA)
panel_40 = Panel(pick_n_choose)
panel_41 = Panel(weave)
panel_42 = Panel(jitter.Values)
panel_43 = Panel(cull_index)
panel_44 = Panel(cull_pattern_3)
quick_graph = QuickGraph(jitter.Values, SortOrder=0)
panel_45 = Panel(cull_pattern_2)
panel_46 = Panel(cull_pattern)
