# Grasshopper definition 3 Vector.gh (Grasshopper 1.0.7)

center_box = CenterBox(Base=PlaneXY(0, 0, 0), X=1, Y=1, Z=1)
populate_3d = Populate3D(Region=center_box, Count="100", Seed=1)

# ---- group: Find neighbors (called Bs) of each point (called A)
closest_points = ClosestPoints(Point=populate_3d, Cloud=populate_3d, Count="4")  # -> ClosestPoint, CPIndex, Distance

# ---- group: For each A, delete ids of Bs which <= A's. The aim of this step is to avoid duplicated connections
series = Series(Start=0, Step=1, Count="100")  # -> graft(Series)
larger_than = LargerThan(FirstNumber=closest_points.CPIndex, SecondNumber=series)  # -> LargerThan, OrEqualTo
cull_pattern = CullPattern(List=closest_points.CPIndex, CullPattern=larger_than.LargerThan)

# ----
list_item = ListItem(List=populate_3d, Index=cull_pattern, Wrap=True)
line = Line(StartPoint=graft(populate_3d), EndPoint=list_item)
panel = Panel(cull_pattern)
