# Grasshopper definition 4 Curve.gh (Grasshopper 1.0.7)

range = Range(Domain=Domain(0, 1), Steps="30")
xy_plane = XYPlane(Origin=Point(0, 0, 0))
multiplication = Multiplication(A=Slider(5.7, range=0..30), B=range)
circle = Circle(Plane=xy_plane, Radius=1)
multiplication_2 = Multiplication(A=Slider(19.3, range=0..100), B=range)
curve_frame = CurveFrame(Curve=circle, Parameter=multiplication_2)
unit_z = UnitZ(Factor=multiplication)
point = Point(curve_frame)
addition = Addition(A=point, B=unit_z)
interpolate = Interpolate(Vertices=addition, Degree=3, Periodic=False, KnotStyle=1)  # -> Curve, Length, Domain
curve_frame_2 = CurveFrame(Curve=reparameterize(interpolate.Curve), Parameter=Slider(0.34, range=0..1))

# ---- group: Surface -> Primitive -> Center Box
center_box = CenterBox(Base=curve_frame_2, X="0.3", Y="0.3", Z="0.3")
