# Grasshopper definition 4.0 Curve.gh (Grasshopper 1.0.7)

xy_plane = XYPlane(Origin=Point(0, 0, 0))
polygon = Polygon(Plane=xy_plane, Radius=Slider(2.02, range=0..3), Segments=Slider(6, range=3..12), FilletRadius=Slider(0.56, range=0..1))  # -> Polygon, Length
circle = Circle(Plane=xy_plane, Radius=Slider(1, range=0..1))
number_slider = Slider(0.85, range=0..3)
number_slider_2 = Slider(2.44, range=0..3)
negative = Negative(Value=number_slider)
negative_2 = Negative(Value=number_slider_2)
construct_domain = ConstructDomain(DomainStart=negative, DomainEnd=number_slider)
construct_domain_2 = ConstructDomain(DomainStart=negative_2, DomainEnd=number_slider_2)
rectangle = Rectangle(Plane=xy_plane, XSize=construct_domain, YSize=construct_domain_2, Radius=Slider(0.18, range=0..1))  # -> Rectangle, Length
