# Grasshopper definition 4.1 Curve.gh (Grasshopper 1.0.7)

boolean_toggle = BooleanToggle(True)
point = Point([Point(-2.215497665, 2.607725009, 0), Point(-0.7677393756, 5.466589479, 0), Point(5.389814868, 0.7567935255, 0), Point(3.887078415, 4.183765679, 0)])
point_2 = Point([Point(-2.453736371, -1.259072447, 0), Point(-2.307127936, 1.709748349, 0), Point(0.2951717735, 0.5185548197, 0), Point(3.758796035, 1.324901209, 0), Point(2.530950398, -2.010440673, 0), Point(0.4234541536, -0.3244436779, 0)])
list_item = ListItem(List=point, Index=0, Wrap=True)  # -> Item, Item1, Item2, Item3
interpolate = Interpolate(Vertices=point_2, Degree=3, Periodic=boolean_toggle, KnotStyle=1)  # -> Curve, Length, Domain
polyline = PolyLine(Vertices=point_2, Closed=boolean_toggle)
nurbs_curve = NurbsCurve(Vertices=point_2, Degree=3, Periodic=boolean_toggle)  # -> Curve, Length, Domain
vector_2pt = Vector2Pt(PointA=list_item.Item, PointB=list_item.Item1, Unitize=False)  # -> Vector, Length
vector_2pt_2 = Vector2Pt(PointA=list_item.Item3, PointB=list_item.Item2, Unitize=False)  # -> Vector, Length

# ---- group: Display -> ...
custom_preview = CustomPreview(Geometry=polyline, Material=ColourSwatch(SwatchColor=RGB(161, 0, 0)))
custom_preview_2 = CustomPreview(Geometry=interpolate.Curve, Material=ColourSwatch(SwatchColor=RGB(0, 161, 0)))
custom_preview_3 = CustomPreview(Geometry=nurbs_curve.Curve, Material=ColourSwatch(SwatchColor=RGB(0, 0, 161)))
vector_display = VectorDisplay(Anchor=list_item.Item, Vector=vector_2pt.Vector)
vector_display_2 = VectorDisplay(Anchor=list_item.Item3, Vector=vector_2pt_2.Vector)

# ----
bezier_span = BezierSpan(StartPoint=list_item.Item, StartTangent=vector_2pt.Vector, EndPoint=list_item.Item3, EndTangent=vector_2pt_2.Vector)  # -> Curve, Length, Domain
