# Grasshopper definition 5.0 Surface.gh (Grasshopper 1.0.7)
# plug-ins: Kangaroo2 Components

# ---- group: Geometry created in "3 Vector.gh"
line = Line(flatten(Tree({0;0;0}: [Line((-0.5026628317, -0.7785120456, -0.06597864026), (-0.3491742757, -0.4728508906, 0.09998556278)), Line((-0.5026628317, -0.7785120456, -0.06597864026), (-0.8806452788, -0.6394226447, -0.2024482522)), Line((-0.5026628317, -0.7785120456, -0.06597864026), (-0.4679849024, -0.6616263425, -0.4934734132))], {0;0;1}: [Line((0.7129296268, 0.5474079938, -0.8223061998), (0.8325748126, 0.2695035745, -0.5464804413)), Line((0.7129296268, 0.5474079938, -0.8223061998), (0.9670328917, 0.9071483966, -0.9745539529)), Line((0.7129296268, 0.5474079938, -0.8223061998), (0.4136973617, 0.8956718761, -0.5733370667))], {0;0;2}: [Line((-0.8079910054, 0.9033796731, -0.03482410267), (-0.7747563747, 0.9670753777, -0.4370379268)), Line((-0.8079910054, 0.9033796731, -0.03482410267), (-0.4053971215, 0.7309416019, -0.02897025227)), Line((-0.8079910054, 0.9033796731, -0.03482410267), (-0.8353869905, 0.4356940265, -0.008481038273))], {0;0;3}: [Line((0.7223414908, 0.8903672965, 0.9440993983), (0.8533808179, 0.4220303769, 0.7825206927)), Line((0.7223414908, 0.8903672965, 0.9440993983), (0.4926103053, 0.9492928125, 0.4826982932)), Line((0.7223414908, 0.8903672965, 0.9440993983), (0.33685262, 0.4425669552, 0.8695846283))], {0;0;4}: [Line((0.736631127, -0.9746284885, 0.9279808662), (0.94105935, -0.9942488717, 0.5279486568)), Line((0.736631127, -0.9746284885, 0.9279808662), (0.8467203471, -0.4464008796, 0.744207668)), Line((0.736631127, -0.9746284885, 0.9279808662), (0.2107989971, -0.8126120976, 0.5854235662))], {0;0;5}: [Line((-0.7958706151, 0.02016541782, -0.9699509535), (-0.525396778, -0.2874585797, -0.8872211789)), Line((-0.7958706151, 0.02016541782, -0.9699509535), (-0.9968415853, 0.4508039632, -0.9827370457)), Line((-0.7958706151, 0.02016541782, -0.9699509535), (-0.5150084903, 0.4933783857, -0.8669869042))]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)))

# ----
cylinder = Cylinder(Base="{2,0,0}", Radius=0.5, Length=1)
cone = Cone(Base="{4,0,0}", Radius=0.5, Length=1)  # -> Cone, Tip
domain_box = DomainBox(Base=PlaneXY(0, 0, 0), X="0 to 1", Y="0 to 1", Z="0 to 1")
sphere = Sphere(Base="{1,3,0}", Radius=1)
quad_sphere = QuadSphere(Base="{4,3,0}", Radius=1)
move = Move(Geometry=line, Motion="{-2,1,0}")  # -> Geometry, Transform
multipipe = MultiPipe(
    Curves=move.Geometry,
    NodeSize=Slider(0.069, range=0..0.1),
    EndOffset=1,
    StrutSize=1,
    Segment=0,
    KinkAngle=0.6,
    CubeFit=0)
