# Grasshopper definition 5.1 Surface.gh (Grasshopper 1.0.7)

# A brep consists of several surfaces.
# Let's construct a brep from scratch.
xy_plane = XYPlane(Origin=Point(0, 0, 0))

# ---- group: Curves
circle = Circle(Plane=xy_plane, Radius=1)
circle_2 = Circle(Plane="{0,0,2}", Radius=1)

# ----
end_points = EndPoints(Curve=circle)  # -> Start, End
end_points_2 = EndPoints(Curve=circle_2)  # -> Start, End

# ---- group: Curves (continued)
line = Line(StartPoint=end_points.Start, EndPoint=end_points_2.Start)

# ---- group: Surfaces
sum_surface = SumSurface(CurveA=circle, CurveB=line)
boundary_surfaces = BoundarySurfaces(Edges=circle)
boundary_surfaces_2 = BoundarySurfaces(Edges=circle_2)

# ----
merge = Merge(Data1=sum_surface, Data2=boundary_surfaces, Data3=boundary_surfaces_2)

# ---- group: Brep
brep_join = BrepJoin(Breps=merge)  # -> Breps, Closed
# Then we deconstruct the brep.
brep = Brep(brep_join.Breps)

# ---- group: Surfaces (continued)
deconstruct_brep = DeconstructBrep(Brep=brep)  # -> Faces, Edges, Vertices

# ----
panel = Panel(deconstruct_brep.Faces)

# ---- group: Curves (continued)
brep_edges = BrepEdges(Brep=brep)  # -> Naked, Interior, NonManifold

# ----
panel_2 = Panel(brep_edges.Interior)
