# Grasshopper definition 5.2 Surface.gh (Grasshopper 1.0.7)

rectangle = Rectangle(Plane=PlaneXY(0, 0, 0), XSize="-1 to 1", YSize="-1 to 1", Radius="0.3")  # -> Rectangle, Length
unit_z = UnitZ(Factor=1)
rectangle_2 = Rectangle(Plane=PlaneXY(0, 0, 0), XSize="-1 to 1", YSize="-1 to 1", Radius="0.3")  # -> Rectangle, Length
unit_z_2 = UnitZ(Factor=1)
rectangle_3 = Rectangle(Plane=PlaneXY(0, 0, 0), XSize="-1 to 1", YSize="-1 to 1", Radius="0.3")  # -> Rectangle, Length
rectangle_4 = Rectangle(Plane=PlaneXY(0, 0, 0), XSize="-1 to 1", YSize="-1 to 1", Radius="0.3")  # -> Rectangle, Length
rectangle_5 = Rectangle(Plane=PlaneXY(0, 0, 0), XSize="-1 to 1", YSize="-1 to 1", Radius="0.3")  # -> Rectangle, Length
rectangle_6 = Rectangle(Plane=PlaneXY(0, 0, 0), XSize="-1 to 1", YSize="-1 to 1", Radius="0.3")  # -> Rectangle, Length
move = Move(Geometry=rectangle.Rectangle, Motion=unit_z)  # -> Geometry, Transform
domain_box = DomainBox(Base=PlaneXY(0, 0, 0), X="-1 to 1", Y="-1 to 1", Z="1")
unit_z_3 = UnitZ(Factor=1)
move_2 = Move(Geometry=rectangle_2.Rectangle, Motion=unit_z_2)  # -> Geometry, Transform
unit_z_4 = UnitZ(Factor=1)
unit_z_5 = UnitZ(Factor=1)
unit_z_6 = UnitZ(Factor=1)
boundary_surfaces = BoundarySurfaces(Edges=rectangle_4.Rectangle)
unit_z_7 = UnitZ(Factor=1)
end_points = EndPoints(Curve=rectangle_6.Rectangle)  # -> Start, End
extrude = Extrude(Base=rectangle_3.Rectangle, Direction=unit_z_3)
merge = Merge(Data1=rectangle_2.Rectangle, Data2=move_2.Geometry)
line_sdl = LineSDL(Start="{0,0,0}", Direction=unit_z_4, Length=1)
boundary_surfaces_2 = BoundarySurfaces(Edges=rectangle.Rectangle)
ruled_surface = RuledSurface(CurveA=rectangle.Rectangle, CurveB=move.Geometry)
boundary_surfaces_3 = BoundarySurfaces(Edges=move.Geometry)
line_sdl_2 = LineSDL(Start=end_points.Start, Direction=unit_z_6, Length=1)

# ---- group: Get edges which is parallel to Z axes
edges_from_directions = EdgesFromDirections(Brep=domain_box, Directions=unit_z_5, Reflex=True, Angle=0)  # -> Edges, Indices, Map

# ----
sum_surface = SumSurface(CurveA=rectangle_5.Rectangle, CurveB=line_sdl)
sweep1 = Sweep1(Rail=rectangle_6.Rectangle, Sections=line_sdl_2, Miter=1)
loft = Loft(Curves=merge, Options={Adjust=False, Closed=False, LoftEnds=0, LoftSimp=0, LoftType=0, Rebuild=10, Refit=0.01})
merge_2 = Merge(Data1=boundary_surfaces_2, Data2=boundary_surfaces_3, Data3=ruled_surface)

# ---- group: They are all same
extrude_2 = Extrude(Base=boundary_surfaces, Direction=unit_z_7)
cap_holes = CapHoles(Brep=extrude)
cap_holes_2 = CapHoles(Brep=sum_surface)
cap_holes_3 = CapHoles(Brep=loft)
cap_holes_4 = CapHoles(Brep=sweep1)
brep_join = BrepJoin(Breps=merge_2)  # -> Breps, Closed

# ---- group: This brep is similar to the ones above (though the shapes are same, the topology of faces and edges are different)
fillet_edge = FilletEdge(Shape=domain_box, Blend=0, Metric=0, Edges=edges_from_directions.Indices, Radii="0.3")
