# Grasshopper definition 5.3 Surface.gh (Grasshopper 1.0.7)

# Let's make a twisted box.
# In fact we can use Twits directly:
panel = Panel("sqrt(2)")
# Let's make the object using more basic methods.
panel_2 = Panel("sqrt(2)")
polygon = Polygon(Plane=PlaneXY(0, 0, 0), Radius=panel, Segments="4", FilletRadius=0)  # -> Polygon, Length
polygon_2 = Polygon(Plane=PlaneXY(0, 0, 0), Radius=panel_2, Segments="4", FilletRadius=0)  # -> Polygon, Length
pi = Pi(Factor=Slider(0.54, range=0..1))
pi_2 = Pi(Factor=Slider(0.54, range=0..1))
range = Range(Domain="2", Steps="10")
boundary_surfaces = BoundarySurfaces(Edges=polygon.Polygon)
unit_z = UnitZ(Factor="2")
unit_z_2 = UnitZ(Factor=range)
range_2 = Range(Domain=pi_2, Steps="10")
extrude = Extrude(Base=boundary_surfaces, Direction=unit_z)
move = Move(Geometry=polygon_2.Polygon, Motion=unit_z_2)  # -> Geometry, Transform
line = Line(StartPoint="{0,0,0}", EndPoint=unit_z)
rotate = Rotate(Geometry=move.Geometry, Angle=range_2, Plane=PlaneXY(0, 0, 0))  # -> Geometry, Transform

# ---- group: Transform -> Morph -> Twist
twist = Twist(Geometry=extrude, Axis=line, Angle=pi, Infinite=Toggle(True), Rigid=False)

# ----
loft = Loft(Curves=rotate.Geometry, Options={Adjust=False, Closed=False, LoftEnds=0, LoftSimp=0, LoftType=0, Rebuild=10, Refit=0.01})
cap_holes = CapHoles(Brep=loft)
