# Grasshopper definition 5.5 Surface.gh (Grasshopper 1.0.7)

quad_sphere = QuadSphere(Base=PlaneXY(0, 0, 0), Radius=1)
deconstruct_brep = DeconstructBrep(Brep=quad_sphere)  # -> Faces, Edges, Vertices
evaluate_surface = EvaluateSurface(Surface=reparameterize(deconstruct_brep.Faces), Point="{0.5,0.5,0}")  # -> Point, Normal, UDirection, VDirection, Frame
brep_edges = BrepEdges(Brep=deconstruct_brep.Faces)  # -> Naked, Interior, NonManifold
move = Move(Geometry=deconstruct_brep.Faces, Motion=evaluate_surface.Normal)  # -> Geometry, Transform
brep_edges_2 = BrepEdges(Brep=move.Geometry)  # -> Naked, Interior, NonManifold
ruled_surface = RuledSurface(CurveA=brep_edges.Naked, CurveB=brep_edges_2.Naked)
merge = Merge(Data1=move.Geometry, Data2=ruled_surface)  # -> flatten(Result)
brep_join = BrepJoin(Breps=merge)  # -> Breps, Closed
