# Grasshopper definition 5.6 Surface.gh (Grasshopper 1.0.7)

number_slider = Slider(15, range=0..100)
multiplication = Multiplication(A=number_slider, B="sqrt(3)/2")
hexagonal = Hexagonal(Plane=PlaneXY(0, 0, 0), Size=1, ExtentX=number_slider, ExtentY=multiplication)  # -> Cells, flatten(Points)
_4point_surface = _4PointSurface(CornerA="{1,1,1}", CornerB="{-1,1,-1}", CornerC="{-1,-1,1}", CornerD="{1,-1,-1}")
circle = Circle(Plane=hexagonal.Points, Radius=Slider(0.55, range=0..1))
bounding_box = BoundingBox(Content=hexagonal.Points, Plane=PlaneXY(0, 0, 0), UnionBox=True)  # -> Box, Box_2
deconstruct_box = DeconstructBox(Box=bounding_box.Box)  # -> Plane, X, Y, Z
panel = Panel("0 to 1")
rectangle = Rectangle(Plane=PlaneXY(0, 0, 0), XSize=deconstruct_box.X, YSize=deconstruct_box.Y, Radius=0)  # -> Rectangle, Length
merge = Merge(Data1=rectangle.Rectangle, Data2=circle)
boundary_surfaces = BoundarySurfaces(Edges=merge)
area = Area(Geometry=boundary_surfaces)  # -> Area, Centroid
sort_list = SortList(Keys=area.Area, ValuesValuesA=boundary_surfaces)  # -> Keys, ValuesValuesA
list_item = ListItem(List=sort_list.ValuesValuesA, Index=0, Wrap=True)  # -> Item1, Item
copy_trim = CopyTrim(Source=list_item.Item1, Target=_4point_surface)
offset_surface_loose = OffsetSurfaceLoose(Surface=copy_trim, Distance="0.1", Retrim=True)
brep_edges = BrepEdges(Brep=copy_trim)  # -> Naked, Interior, NonManifold
brep_edges_2 = BrepEdges(Brep=offset_surface_loose)  # -> Naked, Interior, NonManifold
ruled_surface = RuledSurface(CurveA=brep_edges.Naked, CurveB=brep_edges_2.Naked)
merge_2 = Merge(Data1=copy_trim, Data2=offset_surface_loose, Data3=ruled_surface)  # -> flatten(Result)
brep_join = BrepJoin(Breps=merge_2)  # -> Breps, Closed
