# Grasshopper definition 5.7 Surface.gh (Grasshopper 1.0.7)

series = Series(Start=0, Step=1, Count="5")
unit_x = UnitX(Factor=1)
construct_point = ConstructPoint(XCoordinate=series, YCoordinate=0, ZCoordinate=series)
addition = Addition(A=construct_point, B=unit_x)
addition_2 = Addition(A=construct_point, B=addition)
weave = Weave(Pattern=[0, 1], Stream0=construct_point, Stream1=addition, NullGaps=False)
division = Division(A=addition_2, B="2")
number_slider = Slider(0.077, range=0..1)
polyline = PolyLine(Vertices=weave, Closed=False)
fillet = Fillet(Curve=polyline, Radius=number_slider)
multiplication = Multiplication(A=number_slider, B=Slider(0.563, range=0..1))
negative = Negative(Value=multiplication)
offset_curve_loose = OffsetCurveLoose(Curve=fillet, Distance=multiplication)
offset_curve_loose_2 = OffsetCurveLoose(Curve=fillet, Distance=negative)
ruled_surface = RuledSurface(CurveA=offset_curve_loose, CurveB=offset_curve_loose_2)
unit_y = UnitY(Factor=Slider(5, range=0..10))
division_2 = Division(A=unit_y, B="2")
addition_3 = Addition(A=division_2, B=division)
split_list = SplitList(List=addition_3, Index="1")  # -> ListA, ListB
project = Project(Geometry=split_list.ListB, Plane=PlaneXY(0, 0, 0))  # -> Geometry, Transform
line = Line(StartPoint=split_list.ListB, EndPoint=project.Geometry)
extrude = Extrude(Base=ruled_surface, Direction=unit_y)
pipe = Pipe(Curve=line, Radius=Slider(0.11, range=0..1), Caps="1")
