# Grasshopper definition 6.0 Mesh.gh (Grasshopper 1.0.7)

rectangle = Rectangle(Plane="{3,0,0}", XSize="-1 to 1", YSize="-1 to 1", Radius=0)  # -> Rectangle, Length
center_box = CenterBox(Base=PlaneXY(0, 0, 0), X="1", Y="1", Z="1")
mesh_box = MeshBox(Base=center_box, XCount=10, YCount=10, ZCount=10)
mesh_plane = MeshPlane(Boundary=rectangle.Rectangle, WidthCount=10, HeightCount=10)  # -> Mesh, Area
mesh_sphere = MeshSphere(Base="{0,3,0}", Radius="1", UCount=10, VCount=20)
mesh_sphere_ex = MeshSphereEx(Base="{3,3,0}", Radius="1", Count=5)
