# Grasshopper definition 6.1 Mesh.gh (Grasshopper 1.0.7)

multiplication = Multiplication(A="40", B="2")
mesh_sphere = MeshSphere(Base=PlaneXY(0, 0, 0), Radius="1", UCount="40", VCount=multiplication)
deconstruct_mesh = DeconstructMesh(Mesh=mesh_sphere)  # -> Vertices, Faces, Colours, Normals
xy_plane = XYPlane(Origin=Point(0, 0, 0))
to_polar = ToPolar(Point=deconstruct_mesh.Vertices, System=xy_plane)  # -> Phi, Theta, Radius
panel = Panel(deconstruct_mesh.Faces)
panel_2 = Panel(deconstruct_mesh.Vertices)
multiplication_2 = Multiplication(A=Slider(3, range=0..10), B=to_polar.Phi)
cosine = Cosine(Value=multiplication_2)
addition = Addition(A="{0,0,5}", B=deconstruct_mesh.Vertices)
number = Number("3")
addition_2 = Addition(A=number, B=cosine)
construct_mesh = ConstructMesh(Vertices=addition, Faces=deconstruct_mesh.Faces)
multiplication_3 = Multiplication(A=addition_2, B=deconstruct_mesh.Vertices)
construct_mesh_2 = ConstructMesh(Vertices=multiplication_3, Faces=deconstruct_mesh.Faces)
