# Grasshopper definition 6.3 Mesh.gh (Grasshopper 1.0.7)

rectangle = Rectangle(Plane=PlaneXY(0, 0, 0), XSize="-1 to 1", YSize="-1 to 1", Radius=0)  # -> Rectangle, Length
point = Point([Point(-1.633403508, -0.5083841002, 0), Point(-0.556833152, 0.4439665995, 0), Point(0.214363882, -0.4928566432, 0), Point(1.787812864, 0.1178900012, 0)])
interpolate = Interpolate(Vertices=point, Degree=3, Periodic=False, KnotStyle=1)  # -> Curve, Length, Domain
populate_2d = Populate2D(Region=rectangle.Rectangle, Count="300", Seed=1)
curve_closest_point = CurveClosestPoint(Point=populate_2d, Curve=interpolate.Curve)  # -> Point, Parameter, Distance
voronoi = Voronoi(Points=populate_2d, Boundary=rectangle.Rectangle, BruteForceOverride=False)
division = Division(A=curve_closest_point.Distance, B=Slider(0.25, range=0..1))
negative = Negative(Value=division)
power_of_e = PowerOfE(Value=negative)
number = Number("1")
subtraction = Subtraction(A=number, B=power_of_e)
scale = Scale(Geometry=voronoi, Center=populate_2d, Factor=subtraction)  # -> Geometry, Transform
boundary_surfaces = BoundarySurfaces(Edges=graft(scale.Geometry))  # -> flatten(Surfaces)
