# Grasshopper definition 6.4 Mesh.gh (Grasshopper 1.0.7)

negative = Negative(Value="5")
addition = Addition(A="5", B="5", C="1")
series = Series(Start=negative, Step=1, Count=addition)
multiplication = Multiplication(A="5", B=Slider(0.911, range=0..1))
multiplication_2 = Multiplication(A="5", B=Slider(1, range=0..1))
construct_domain = ConstructDomain(DomainStart=multiplication, DomainEnd=multiplication_2)
cross_reference = CrossReference(ListA=series, ListB=series, ListC=series, CrossMode=1)  # -> ListA, ListB, ListC
construct_point = ConstructPoint(XCoordinate=cross_reference.ListA, YCoordinate=cross_reference.ListB, ZCoordinate=cross_reference.ListC)
vector_length = VectorLength(Vector=construct_point)
includes = Includes(Value=vector_length, Domain=construct_domain)  # -> Includes, Deviation
cull_pattern = CullPattern(List=construct_point, CullPattern=includes.Includes)
unit_vector = UnitVector(Vector=cull_pattern)
point = Point(unit_vector)
voronoi_cell = VoronoiCell(Point="{0,0,0}", Neighbours=point)
brep_edges = BrepEdges(Brep=voronoi_cell)  # -> Naked, Interior, NonManifold

# ---- group: Display -> Preview -> Custom Preview
custom_preview = CustomPreview(
    Geometry=brep_edges.Interior,
    Material={diffuse=RGB(221, 160, 221), emission=RGB(66, 48, 66), shine=0.5, specular=RGB(255, 255, 255), transparency=0})
