# Grasshopper definition 6.5 Mesh.gh (Grasshopper 1.0.7)

rectangle = Rectangle(Plane=PlaneXY(0, 0, 0), XSize="-1 to 1", YSize="-1 to 1", Radius=0)  # -> Rectangle, Length
populate_2d = Populate2D(Region=rectangle.Rectangle, Count=100, Seed=1)
number_slider = Slider(0.00299, range=0..0.01)
vector_length = VectorLength(Vector=populate_2d)
longest_list = LongestList(ListA=populate_2d, ListB=number_slider, PaddingMode=2)  # -> ListA, ListB
division = Division(A=vector_length, B=Slider(0.626, range=0..1))
xy_plane = XYPlane(Origin=Point(0, 0, 0))
negative = Negative(Value=division)
power_of_e = PowerOfE(Value=negative)
multiplication = Multiplication(A=power_of_e, B=number_slider)
metaball_t_custom = MetaBallTCustom(Points=populate_2d, Charge=multiplication, Plane=xy_plane, Threshold=0.5, Accuracy="0.01")
