# Grasshopper definition 6.6 Mesh (difficult).gh (Grasshopper 1.0.7)

number_slider = Slider(8, range=0..10)
square = Square(Value=number_slider)
cube = Cube(Value=number_slider)
random = Random(Range=Domain(0, 1), Number=cube, Seed=2)
partition_list = PartitionList(List=random, Size=square)
partition_list_2 = PartitionList(List=partition_list, Size=number_slider)  # -> simplify(Chunks)
point = Point([Point(0.2226568892, 0.1841182835, 0), Point(0.7350629722, 0.6913485474, 0)])
domain = Domain("-1 to 1")
mesh_sphere_ex = MeshSphereEx(Base=PlaneXY(0, 0, 0), Radius="1", Count="20")
deconstruct_mesh = DeconstructMesh(Mesh=mesh_sphere_ex)  # -> Vertices, Faces, Colours, Normals
deconstruct = Deconstruct(Point=flatten(deconstruct_mesh.Vertices))  # -> XComponent, YComponent, ZComponent
remap_numbers = RemapNumbers(Value=deconstruct.XComponent, Source=domain, Target=Domain(0, 1))  # -> Mapped, Clipped
remap_numbers_2 = RemapNumbers(Value=deconstruct.YComponent, Source=domain, Target=Domain(0, 1))  # -> Mapped, Clipped
remap_numbers_3 = RemapNumbers(Value=deconstruct.ZComponent, Source=domain, Target=Domain(0, 1))  # -> Mapped, Clipped
interpolate_data = InterpolateData(Data=partition_list_2, Parameter=remap_numbers.Mapped, Interpolation=3)
stack_data = StackData(Data=remap_numbers_2.Mapped, Stack=number_slider)
path_mapper = PathMapper(interpolate_data, source="{A;B}(C)", target="{C;A}(B)")
list_item = ListItem(List=path_mapper, Index=0, Wrap=True)
unflatten_tree = UnflattenTree(Tree=stack_data, Guide=list_item)
interpolate_data_2 = InterpolateData(Data=path_mapper, Parameter=unflatten_tree, Interpolation=3)
path_mapper_2 = PathMapper(interpolate_data_2, source="{A;B}(C)", target="{C;A}(B)")
interpolate_data_3 = InterpolateData(Data=path_mapper_2, Parameter=graft(remap_numbers_3.Mapped), Interpolation=3)  # -> flatten(Value)
number = Number("1")
multiplication = Multiplication(A=Slider(0.655, range=0..1), B=interpolate_data_3)
addition = Addition(A=number, B=multiplication)
multiplication_2 = Multiplication(A=addition, B=deconstruct_mesh.Vertices)
construct_mesh = ConstructMesh(Vertices=multiplication_2, Faces=deconstruct_mesh.Faces)
