# Grasshopper definition 7 Intersect.gh (Grasshopper 1.0.7)

unit_z = UnitZ(Factor="-2")
cylinder = Cylinder(Base=unit_z, Radius=Slider(0.788, range=0..1), Length="4")
xy_plane = XYPlane(Origin=Point(0, 0, 0))
yz_plane = YZPlane(Origin=Point(0, 0, 0))
xz_plane = XZPlane(Origin=Point(0, 0, 0))
cap_holes = CapHoles(Brep=cylinder)
merge = Merge(Data1=xy_plane, Data2=yz_plane, Data3=xz_plane)

# ---- group: Tansform -> Orient
orient = Orient(Geometry=cap_holes, Source=PlaneXY(0, 0, 0), Target=merge)  # -> Geometry, Transform

# ----
solid_union = SolidUnion(Breps=orient.Geometry)
domain_box = DomainBox(Base=PlaneXY(0, 0, 0), X="-1 to 1", Y="-1 to 1", Z="-1 to 1")
solid_difference = SolidDifference(BrepsA=domain_box, BrepsB=solid_union)
