# Grasshopper definition 8 Transform.gh (Grasshopper 1.0.7)

xy_plane = XYPlane(Origin=Point(0, 0, 0))
unit_x = UnitX(Factor=Slider(3.86, range=0..10))
center_box = CenterBox(Base=xy_plane, X=1, Y=1, Z=1)
move = Move(Geometry=center_box, Motion=unit_x)  # -> Geometry, Transform
multiplication = Multiplication(A=Slider(0.16, range=0..1), B="2*pi")
rotate = Rotate(Geometry=move.Geometry, Angle=multiplication, Plane=PlaneXY(0, 0, 0))  # -> Geometry, Transform
sphere = Sphere(Base=PlaneXY(0, 0, 0), Radius=1)
scale = Scale(Geometry=rotate.Geometry, Center=Point(0, 0, 0), Factor=Slider(0.67, range=0..1))  # -> Geometry, Transform
merge = Merge(Data1=move.Transform, Data2=rotate.Transform, Data3=scale.Transform)
panel = Panel(merge)
compound = Compound(Transforms=merge)
transform = Transform(Geometry=sphere, Transform=compound)
panel_2 = Panel(compound)
