# Grasshopper definition 9 Display.gh (Grasshopper 1.0.7)

sphere = Sphere(Base=PlaneXY(0, 0, 0), Radius=1)
rectangle = Rectangle(Plane=PlaneXY(0, 0, 0), XSize="3 to 7", YSize="-2 to 2", Radius=0)  # -> Rectangle, Length
range = Range(Domain=Domain(0, 1), Steps="25")  # -> graft(Range)
range_2 = Range(Domain=Domain(0, 1), Steps="25")
domain_box = DomainBox(Base=PlaneXY(0, 0, 0), X="8 to 12", Y="-2 to 2", Z="-2 to 2")
populate_geometry = PopulateGeometry(Geometry=sphere, Count=100, Seed=1)
panel = Panel("""a
b
c
a
a""")
subtraction = Subtraction(A="5", B="1")
random = Random(Range=Domain(0, 1), Number="1000", Seed=2)
populate_2d = Populate2D(Region=rectangle.Rectangle, Count="5", Seed="2")
custom_preview = CustomPreview(Geometry=sphere, Material=ColourSwatch(SwatchColor=RGBA(0, 174, 255, 155)))
multiplication = Multiplication(A=range, B="5")
multiplication_2 = Multiplication(A=range_2, B="5")
populate_3d = Populate3D(Region=domain_box, Count="100", Seed=1)
range_3 = Range(Domain=Domain(0, 1), Steps=subtraction)
colour_wheel = ColourWheel(
    "100",
    ColourGrips_Style=20,
    ColourGrips_Grip=[5.78233342, 3.420024308, 4.188790205, 3.141592654],
    ColourGrips_Lum=[0.3997619036, 0.7694166474],
    ColourGrips_Range=[0.4526122481, 0.2617993878, 0.2617993878, 0.2617993878],
    ColourGrips_Sat=[0.4464271057, 0.5720828003])
text_tag = TextTag(Location="{0,0,3}", Text="Text", Colour=ColourSwatch(SwatchColor=RGB(0, 0, 0)))
gradient = Gradient(
    LowerLimit=0,
    UpperLimit=1,
    Parameter=range_3,
    stops=[0: RGB(234, 38, 0), 0.25: RGB(234, 126, 0), 0.5: RGB(254, 244, 84), 0.75: RGB(173, 203, 249), 1: RGB(75, 107, 169)])
brep_closest_point = BrepClosestPoint(Point=populate_geometry, Brep=sphere)  # -> Point, Normal, Distance
quick_graph = QuickGraph(random, SortOrder=0)
pie_chart = PieChart(panel)
bar_graph = BarGraph(random, BarColor=RGB(255, 0, 90))
point_order = PointOrder(Points=populate_2d)
colour_hsl = ColourHSL(Alpha=1, Hue=range_2, Saturation=1, Luminance=range)
construct_point = ConstructPoint(XCoordinate=multiplication_2, YCoordinate="4", ZCoordinate=multiplication)
vector_display = VectorDisplay(Anchor=brep_closest_point.Point, Vector=brep_closest_point.Normal)
point_list = PointList(Points=populate_2d, Size="0.35")
custom_preview_2 = CustomPreview(Geometry=construct_point, Material=colour_hsl)
dot_display = DotDisplay(Point=populate_3d, Colour=colour_wheel, Size="0.5")
cloud_display = CloudDisplay(Points=populate_2d, Colours=gradient, Size=1, SpriteType=0)
